# Grasshopper definition team_04_working.gh (Grasshopper 1.0.8)
# plug-ins: Human, Swiftlet

# ----
# Connect MCP Tools to Decall and Update All Clusters
button = Button()
# IF SOMETHING IS NOT
# WORKING PRESS THIS
# BUTTON FIRST
toggle = BooleanToggle(True)
update_all_clusters = CSharpScript(update=button, recursive=toggle)  # -> out, A; inputs update: Boolean, recursive: Boolean, passwords: list of String, localPath: String
# ---------- update_all_clusters: C# ----------
using System;
using System.Collections;
using System.Collections.Generic;

using Rhino;
using Rhino.Geometry;

using Grasshopper;
using Grasshopper.Kernel;
using Grasshopper.Kernel.Data;
using Grasshopper.Kernel.Types;
using System.Windows.Forms;
using System.Linq;
/// <summary>
/// This class will be instantiated on demand by the Script component.
/// </summary>
public class Script_Instance : GH_ScriptInstance
{
  /// <summary>Print a String to the [Out] Parameter of the Script component.</summary>
  /// <param name="text">String to print.</param>
  private void Print(string text) { /* Implementation hidden. */ }
  /// <summary>Print a formatted String to the [Out] Parameter of the Script component.</summary>
  /// <param name="format">String format.</param>
  /// <param name="args">Formatting parameters.</param>
  private void Print(string format, params object[] args) { /* Implementation hidden. */ }
  /// <summary>Print useful information about an object instance to the [Out] Parameter of the Script component. </summary>
  /// <param name="obj">Object instance to parse.</param>
  private void Reflect(object obj) { /* Implementation hidden. */ }
  /// <summary>Print the signatures of all the overloads of a specific method to the [Out] Parameter of the Script component. </summary>
  /// <param name="obj">Object instance to parse.</param>
  private void Reflect(object obj, string method_name) { /* Implementation hidden. */ }

  /// <summary>Gets the current Rhino document.</summary>
  private readonly RhinoDoc RhinoDocument;
  /// <summary>Gets the Grasshopper document that owns this script.</summary>
  private readonly GH_Document GrasshopperDocument;
  /// <summary>Gets the Grasshopper script component that owns this script.</summary>
  private readonly IGH_Component Component;
  /// <summary>
  /// Gets the current iteration count. The first call to RunScript() is associated with Iteration==0.
  /// Any subsequent call within the same solution will increment the Iteration count.
  /// </summary>
  private readonly int Iteration;

  /// <summary>
  /// This procedure contains the user code. Input parameters are provided as regular arguments,
  /// Output parameters as ref arguments. You don't have to assign output parameters,
  /// they will have a default value.
  /// </summary>
  private void RunScript(
		bool update,
		bool recursive,
		List<string> passwords,
		string localPath,
		ref object A)
  {

    A = updateLog;
    if (update)
    {
      updateLog = new List<string>();
      _passwords = passwords;
      UpdateClusters(GrasshopperDocument, recursive, localPath);
    }

  }

  // <Custom additional code> 
  List<string> updateLog;
  List<String> _passwords;

  void UpdateClusters (GH_Document ghDoc, bool recursive, string localPath)
  {
    foreach (var obj in ghDoc.Objects)
    {
      var cluster = obj as Grasshopper.Kernel.Special.GH_Cluster;
      if (cluster != null)
      {
        var clusterPath = cluster.FilePath;
        if (!string.IsNullOrEmpty(clusterPath))
        {
          if (cluster.Synchronisation == Grasshopper.Kernel.Special.GH_Synchronisation.OutOfDate)
          {
            cluster.CreateFromFilePath(clusterPath);
            updateLog.Add("Updated: " + clusterPath);
          }
          else if (cluster.Synchronisation == Grasshopper.Kernel.Special.GH_Synchronisation.MissingReference)
          {
            string newPath = ReplacePath(localPath, clusterPath);
            if (!string.IsNullOrEmpty(newPath))
            {
              cluster.CreateFromFilePath(newPath);
              updateLog.Add("Replaced and updated: " + newPath);
            }
            else
            {
              updateLog.Add("Missing reference: " + clusterPath);
            }

          }
        }

        //Update recursively
        if (recursive)
        {
          GH_Document clusterDoc = GetClusterDoc(cluster);
          if (clusterDoc != null)
            UpdateClusters(clusterDoc, recursive, localPath);
        }
      }
    }
  }

  GH_Document GetClusterDoc(Grasshopper.Kernel.Special.GH_Cluster cluster)
  {
    //no pass needed
    var doc = cluster.Document(string.Empty);
    if (doc != null)
      return doc;

    //try passwords
    if (_passwords != null && _passwords.Any())
    {
      foreach (var pass in _passwords)
      {
        doc = cluster.Document(pass);
        if (doc != null)
          return doc;
      }
    }

    return null;
  }

  string ReplacePath(string localPath, string missingPath)
  {
    if (String.IsNullOrEmpty(missingPath) || string.IsNullOrEmpty(localPath))
      return null;
    else
    {
      string lastLocalPart = localPath.Split('\\').Last();
      string[] parts = missingPath.Split('\\');
      if (parts.Contains(lastLocalPart))
      {
        int i = Array.IndexOf(parts, lastLocalPart);
        string clusterPath = String.Join("\\", parts.Skip(i + 1));
        string result = String.Join("\\", localPath, clusterPath);
        return result;
      }
      else
        return null;
    }
  }
  // </Custom additional code> 
}
# ---------- end update_all_clusters ----------
connect_mcp_tools_to_decall = CSharpScript(nickname_From="Central MCP Server", nickname_To="Central DeCall", connect=button)  # -> out; inputs nickname_From: String, nickname_To: String, connect: Boolean
# ---------- connect_mcp_tools_to_decall: C# ----------
using System;
using System.Linq;
using Grasshopper;
using Grasshopper.Kernel;

public class Script_Instance : GH_ScriptInstance
{
    private void RunScript(string nickname_From, string nickname_To, bool connect)
    {
        if (!connect) return;
        Console.Write($"Attempting to connect outputs from '{nickname_From}' to '{nickname_To}'...");

        var ghDoc = Instances.ActiveCanvas?.Document;
        if (ghDoc == null) return;

        var compFrom = ghDoc.Objects
            .OfType<IGH_Component>()
            .FirstOrDefault(o => o.NickName == nickname_From);

        var compTo = ghDoc.Objects
            .OfType<IGH_Param>()
            .FirstOrDefault(o => o.NickName == nickname_To);

        if (compFrom != null && compTo != null)
        {
            ghDoc.ScheduleSolution(5, doc => Connect(doc, compFrom, compTo));
        }
    }

    // <Custom additional code> 
    private void Connect(GH_Document doc, IGH_Component compFrom, IGH_Param compTo)
    {
        if (compFrom == null || compTo == null) return;

        foreach (IGH_Param param in compFrom.Params.Output)
        {
            compTo.AddSource(param);
        }
    }
}
# ---------- end connect_mcp_tools_to_decall ----------
panel = Panel(connect_mcp_tools_to_decall)

c_script = CSharpScript()  # -> out, availablePort
# ---------- c_script: C# ----------
// Grasshopper Script Instance
// This script finds an available port on the local machine.
#region Usings
using System;
using System.Linq;
using System.Collections;
using System.Collections.Generic;
using System.Drawing;
using System.Net;
using System.Net.Sockets;

using Rhino;
using Rhino.Geometry;

using Grasshopper;
using Grasshopper.Kernel;
using Grasshopper.Kernel.Data;
using Grasshopper.Kernel.Types;
#endregion

public class Script_Instance : GH_ScriptInstance
{
    #region Notes
    /* 
      Members:
        RhinoDoc RhinoDocument
        GH_Document GrasshopperDocument
        IGH_Component Component
        int Iteration

      Methods (Virtual & overridable):
        Print(string text)
        Print(string format, params object[] args)
        Reflect(object obj)
        Reflect(object obj, string method_name)
    */
    #endregion

    private void RunScript(object start, object end, ref object availablePort)
    {
        // Use default values if parameters are not provided
        int startPort = (start != null && int.TryParse(start.ToString(), out int s)) ? s : 3001;
        int endPort = (end != null && int.TryParse(end.ToString(), out int e)) ? e : 3100;

        // Find an available port in the specified range
        try
        {
            availablePort = FindAvailablePortInRange(startPort, endPort);
            Print($"Available port found: {availablePort}");
        }
        catch (Exception ex)
        {
            Print($"Error: {ex.Message}");
            availablePort = null;
        }
    }

    /// <summary>
    /// Checks if a local TCP port is available for binding (i.e., not in use).
    /// Returns True if available, False otherwise.
    /// </summary>
    private bool IsPortAvailableForBind(int port)
    {
        try
        {
            // Create a new TCP socket
            using (Socket socket = new Socket(AddressFamily.InterNetwork, SocketType.Stream, ProtocolType.Tcp))
            {
                // Try to bind to the port on all interfaces (0.0.0.0)
                socket.Bind(new IPEndPoint(IPAddress.Any, port));
                // If successful, the socket is closed by the using statement and return True
                return true;
            }
        }
        catch (SocketException)
        {
            // If binding fails, it means the port is already in use
            return false;
        }
    }

    /// <summary>
    /// Finds an available port by letting the OS assign one.
    /// </summary>
    private int FindAvailablePort()
    {
        Socket socket = new Socket(AddressFamily.InterNetwork, SocketType.Stream, ProtocolType.Tcp);
        socket.Bind(new IPEndPoint(IPAddress.Any, 0)); // Bind to an available port assigned by the OS
        int availablePort = ((IPEndPoint)socket.LocalEndPoint).Port; // Get the assigned port number
        socket.Close(); // Close the socket
        return availablePort;
    }

    /// <summary>
    /// Finds the first available port in a given range.
    /// </summary>
    private int FindAvailablePortInRange(int start = 3001, int end = 3100)
    {
        for (int port = start; port <= end; port++)
        {
            if (IsPortAvailableForBind(port))
                return port;
        }
        throw new Exception($"No available ports found in the range {start}-{end}.");
    }
}
# ---------- end c_script ----------
team_04_definition_cluster = Team04DefinitionCluster()
panel_2 = Panel(c_script.availablePort)
central_mcp_server = MCPServer(Port=c_script.availablePort, Tools=team_04_definition_cluster, ServerName="Swiftlet")
get_tool_names = CSharpScript(x=team_04_definition_cluster)  # -> flatten(out)
# ---------- get_tool_names: C# ----------
// Grasshopper Script Instance
#region Usings
using System;
using System.Linq;
using System.Collections;
using System.Collections.Generic;
using System.Drawing;

using Rhino;
using Rhino.Geometry;

using Grasshopper;
using Grasshopper.Kernel;
using Grasshopper.Kernel.Data;
using Grasshopper.Kernel.Types;
#endregion

public class Script_Instance : GH_ScriptInstance
{
    #region Notes
    /* 
      Members:
        RhinoDoc RhinoDocument
        GH_Document GrasshopperDocument
        IGH_Component Component
        int Iteration

      Methods (Virtual & overridable):
        Print(string text)
        Print(string format, params object[] args)
        Reflect(object obj)
        Reflect(object obj, string method_name)
    */
    #endregion

    private void RunScript(object x)
    {
        dynamic dynamicX = x;
        Console.Write(dynamicX.Name);
    }
}
# ---------- end get_tool_names ----------
central_decall = Data(central_mcp_server)
clean = CleanTree(RemoveNulls=True, RemoveInvalid=True, RemoveEmpty=False, Tree=central_decall)

# ---- group: Input Layout
json_file_path = FilePath("C:\Users\danie\Documents\GitHub\term 3\AIAStudio\AIA26_Studio\layout_input\layout_schema.json")
json2string = Python3Script(path=json_file_path)  # -> out, json_string
# ---------- json2string: Python ----------
import sys
import json
from pathlib import Path


def read_json_as_string(path):
    path = Path(path)

    if not path.exists():
        raise FileNotFoundError(f"File not found: {file_path}")

    with open(path, "r", encoding="utf-8") as f:
        data = json.load(f)

    # Convert JSON object back to string
    json_string = json.dumps(data)

    return json_string

json_string = read_json_as_string(path)
# ---------- end json2string ----------

# ----
panel_3 = Panel(json_file_path)
team_04_result_cluster = Team04ResultCluster(tool_call_request=clean)  # -> tool_names_3, tool_call_success

# ---- group: Output Layout
json_file_path_2 = FilePath("C:\Users\danie\Documents\GitHub\term 3\AIAStudio\AIA26_Studio\team_01\team_01_edited_layout.json")
json2string_2 = Python3Script(path=json_file_path_2)  # -> out, json_string; same code as json2string

# ----
# Tool Names from the Results Clusters
# Tool Names from the Definition Clusters
# These Two Clusters should be EXACTLY THE SAME
panel_4 = Panel(get_tool_names)
panel_5 = Panel(team_04_result_cluster.tool_names_3)

rec = DataRecorder(team_04_result_cluster.tool_call_success, DataLimit=-10, RecordData=True)
rec_2 = DataRecorder(clean, DataLimit=-10, RecordData=True)
panel_6 = Panel(json_file_path_2)

# ---- group: 0 = Before, 1= After
# Visualize Layout from JSON: Before and After
number_slider = Slider(1, range=0..1)

# ----
response_ok = Panel(rec)
called_tool_name = Panel(rec_2)
filter = StreamFilter(Gate=number_slider, Stream0=json2string.json_string, Stream1=json2string_2.json_string)

# ---- group: Extractor Tool do map json to grasshopper data
extractor = Python3Script(json_str=filter)  # -> out, outline_curve, room_names, room_curves, door_names, door_curves, window_names, window_curves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
# ---------- extractor: Python ----------
import json
import Rhino.Geometry as rg

def load_json_from_string(json_string):
    try:
        data = json.loads(json_string)
    except Exception as e:
        raise ValueError(f"Invalid JSON string: {e}")
    return data

def create_polyline(points, close=True):
    """Create a Rhino PolylineCurve from 2D points"""
    pts = [rg.Point3d(x, y, 0) for x, y in points]

    if close and pts[0] != pts[-1]:
        pts.append(pts[0])

    return rg.Polyline(pts).ToPolylineCurve()

def create_line(points):
    """Create a Rhino LineCurve from 2 points"""
    if len(points) != 2:
        return None
    p1 = rg.Point3d(points[0][0], points[0][1], 0)
    p2 = rg.Point3d(points[1][0], points[1][1], 0)
    return rg.LineCurve(p1, p2)

# Load JSON
layout = load_json_from_string(json_str)

# ------------------------
# ROOMS (polygons)
# ------------------------
room_names = []
room_curves = []

for room in layout.get("rooms", []):
    name = room.get("name")
    geometry = room.get("geometry")

    if name and geometry:
        curve = create_polyline(geometry, close=True)
        room_names.append(name)
        room_curves.append(curve)

# ------------------------
# DOORS (lines)
# ------------------------
door_names = []
door_curves = []

for door in layout.get("doors", []):
    name = door.get("name")
    geometry = door.get("geometry")

    if name and geometry:
        curve = create_line(geometry)
        if curve:
            door_names.append(name)
            door_curves.append(curve)

# ------------------------
# WINDOWS (lines)
# ------------------------
window_names = []
window_curves = []

for window in layout.get("windows", []):
    name = window.get("name")
    geometry = window.get("geometry")

    if name and geometry:
        curve = create_line(geometry)
        if curve:
            window_names.append(name)
            window_curves.append(curve)

# ------------------------
# FURNITURE (polygons)
# ------------------------
furniture_names = []
furniture_curves = []

for furn in layout.get("furniture", []):
    name = furn.get("name")
    geometry = furn.get("geometry")

    if name and geometry:
        curve = create_polyline(geometry, close=True)
        furniture_names.append(name)
        furniture_curves.append(curve)

# ------------------------
# MEP (polygons)
# ------------------------
mep_names = []
mep_curves = []

for m in layout.get("mep", []):
    name = m.get("name")
    geometry = m.get("geometry")

    if name and geometry:
        curve = create_polyline(geometry, close=True)
        mep_names.append(name)
        mep_curves.append(curve)

# ------------------------
# STRUCTURE (lines)
# ------------------------
structure_names = []
structure_curves = []

for s in layout.get("structure", []):
    name = s.get("name")
    geometry = s.get("geometry")

    if name and geometry:
        curve = create_line(geometry)
        if curve:
            structure_names.append(name)
            structure_curves.append(curve)

# ------------------------
# OUTLINE (optional)
# ------------------------
outline_curve = None
if "outline" in layout:
    outline_curve = create_polyline(layout["outline"], close=True)

# ------------------------
# OUTPUTS
# ------------------------
a = room_names
b = room_curves

c = door_names
d = door_curves

e = window_names
f = window_curves

g = furniture_names
h = furniture_curves

i = mep_names
j = mep_curves

k = structure_names
l = structure_curves

m = outline_curve
# ---------- end extractor ----------

# ---- group: Polylines
srf = Surface(extractor.room_curves)
preview = CustomPreview(Geometry=srf, Material=[ColourSwatch(SwatchColor=RGB(167, 219, 44)), ColourSwatch(SwatchColor=RGB(4, 154, 184))])

# ---- group: Windows
data = Data(extractor.window_curves)
previewlw = CustomPreviewLineweights(Geometry=data, Shader=ColourSwatch(SwatchColor=RGB(56, 56, 56)), Thickness=Slider(5.4, range=0..10), Absolute=False)

# ---- group: Labels
area = Area(Geometry=srf)  # -> Area, Centroid
tag = TextTag(Location=area.Centroid, Text=extractor.room_names)

# ----
# Debug Tool Names
# This Panel should always be TRUE
tool_names_from_the_results_clusters = Data(panel_5)
tool_names_from_the_definition_clusters = Data(panel_4)
join = TextJoin(Text=flatten(tool_names_from_the_definition_clusters))
join_2 = TextJoin(Text=flatten(tool_names_from_the_results_clusters))
tstat = TreeStatistics(Tree=tool_names_from_the_definition_clusters)  # -> Paths, Length, Count
tstat_2 = TreeStatistics(Tree=tool_names_from_the_results_clusters)  # -> Paths, Length, Count
dpath = DeconstructPath(Branch=tstat.Paths)
dpath_2 = DeconstructPath(Branch=tstat_2.Paths)
equals = Equality(FirstNumber=tstat.Length, SecondNumber=tstat_2.Length)  # -> Equality, Inequality
equals_2 = Equality(FirstNumber=tstat.Count, SecondNumber=tstat_2.Count)  # -> Equality, Inequality
ma = MassAddition(Input=flatten(equals.Equality))  # -> Result, PartialResults
equals_3 = Equality(FirstNumber=dpath, SecondNumber=dpath_2)  # -> Equality, Inequality
lng = ListLength(List=equals.Equality)
ma_2 = MassAddition(Input=flatten(equals_3.Inequality))  # -> Result, PartialResults
equals_4 = Equality(FirstNumber=ma.Result, SecondNumber=lng)  # -> Equality, Inequality
does_quantity_of_tools_match = Panel(equals_2.Equality)
equals_5 = Equality(FirstNumber=ma_2.Result, SecondNumber="0")  # -> Equality, Inequality
does_quantity_of_tools_match_per_team = Panel(equals_4.Equality)
are_all_teams_included = Panel(equals_5.Equality)

tmatch = MatchText(Text=join, Pattern=join_2, Case=True)

do_all_names_match = Panel(tmatch)
and = GateAnd(A=equals_5.Equality, B=equals_4.Equality, C=equals_2.Equality, D=tmatch)  # -> flatten(Result)
do_trees_match = Panel(and)

# ==== cluster Team04ResultCluster

siteboundary = Curve(<curve referenced from the Rhino model>)
context = Brep([<brep referenced from the Rhino model> x3740])
road = Curve([<curve referenced from the Rhino model> x2])
surface = Surface(siteboundary)
surface_2 = Surface(road)
divide_domain² = DivideDomain²(Domain=surface, UCount=10, VCount=10)
isotrim = Isotrim(Surface=surface, Domain=divide_domain²)
area = Area(Geometry=isotrim)  # -> Area, Centroid
point_in_curve = PointInCurve(Point=area.Centroid, Curve=siteboundary)  # -> Relationship, Point
gene_pool = GenePool(Decimals=0, Maximum=70, Minimum=0, Value=[25, 38, 31, 35, 48, 0, 22, 39, 35, 33])
cull_pattern = CullPattern(List=area.Centroid, CullPattern=point_in_curve.Relationship)  # -> flatten(List)
cull_pattern_2 = CullPattern(List=area.Centroid, CullPattern=point_in_curve.Relationship)
list_item = ListItem(List=cull_pattern_2, Index=gene_pool, Wrap=False)
flatten_tree = FlattenTree(Tree=cull_pattern_2, Path="{0}")

# ----
# Team 04 Result Cluster
# CYLINDER TEAM
# Edit Tool Names to
# Match Definition Cluster
tool_names = Panel("parametric_shape_generator")

# ----
# Sorting Logic, Please Do Not Edit
tool_call_request = ClusterInput()
tool_names_2 = Text(tool_names)
decall = DeconstructToolCall(Request=tool_call_request)  # -> Request, Tool, Arguments
mindex = MemberIndex(Set=tool_names, Member=decall.Tool)  # -> Index, Count

# ---- group: Cluster Output
tool_names_3 = ClusterOutput(tool_names_2)

# ----
sift = SiftPattern(List=decall.Request, SiftPattern=mindex.Index)
deconstruct_tool_call = DeconstructToolCall(Request=sift)  # -> Request, Tool, Arguments
get_json_object_key = GetJSONObjectKey(JObject=deconstruct_tool_call.Arguments, Key="genes_json")
get_json_object_key_2 = GetJSONObjectKey(JObject=deconstruct_tool_call.Arguments, Key="locked_shape_type")
get_json_object_key_3 = GetJSONObjectKey(JObject=deconstruct_tool_call.Arguments, Key="iterations")
get_json_object_key_4 = GetJSONObjectKey(JObject=deconstruct_tool_call.Arguments, Key="seed")
read_json_value = ReadJSONValue(JValue=get_json_object_key_3)  # -> AsString, AsNumber, AsBool
read_json_value_2 = ReadJSONValue(JValue=get_json_object_key)  # -> AsString, AsNumber, AsBool
read_json_value_3 = ReadJSONValue(JValue=get_json_object_key_2)  # -> AsString, AsNumber, AsBool
read_json_value_4 = ReadJSONValue(JValue=get_json_object_key_4)  # -> AsString, AsNumber, AsBool
script = Script(
    genes_json=read_json_value_2.AsString,
    locked_shape_type=read_json_value_3.AsString,
    site_boundary=siteboundary,
    tree_points=list_item,
    iterations=read_json_value.AsNumber,
    seed=read_json_value_4.AsNumber)  # -> mesh, vertices, faces, metadata, genes_payload, error
# ---------- script: Python ----------
"""
Grasshopper Python component - generative design optimizer.

Inputs to create in Grasshopper:
- genes_json or genes: JSON string or dictionary with the user request / seed genes
- iterations: number of candidates to evaluate
- seed: optional integer random seed
- locked_shape_type: optional override for typology lock
- site_boundary: optional site boundary polygon or boundary payload
- tree_points: optional list of tree positions for overlap penalties

Example genes:
{
  "shape_type": "u_shape",
  "length": 40,
  "width": 30,
  "height": 15,
  "rotation": 45
}

Outputs:
- mesh: Rhino mesh for the best candidate
- vertices: text summary of vertices
- faces: text summary of faces
- metadata: fitness summary text
- genes_payload: normalized best genes JSON
- error: error message if any
"""

from __future__ import annotations

import importlib
import json
import math
import random
import sys
from typing import Any

mesh = None
vertices = None
faces = None
metadata = None
genes_payload = None
error = None


def _coerce_text(value: Any) -> str:
    if value is None:
        return ""
    if hasattr(value, "ToString"):
        value = value.ToString()
    return str(value)


def _coerce_payload(value: Any) -> dict[str, Any]:
    if value is None:
        return {}
    if isinstance(value, dict):
        return dict(value)
    if hasattr(value, "ToString"):
        value = value.ToString()
    if not isinstance(value, str):
        value = str(value)
    value = value.strip()
    if not value:
        return {}
    if value.startswith("{") or value.startswith("["):
        parsed = json.loads(value)
        if isinstance(parsed, dict):
            return parsed
        return {"genes_list": parsed}
    return {"shape_type": value}


def _coerce_list_payload(value: Any) -> list[Any]:
    if value is None:
        return []
    if isinstance(value, list):
        return value
    if hasattr(value, "ToString"):
        value = value.ToString()
    if not isinstance(value, str):
        value = str(value)
    value = value.strip()
    if not value:
        return []
    if value.startswith("["):
        parsed = json.loads(value)
        return parsed if isinstance(parsed, list) else []
    return []


def _point_in_polygon(point: list[float], polygon: list[list[float]]) -> bool:
    x, y = point[0], point[1]
    inside = False
    count = len(polygon)
    for index in range(count):
        x1, y1 = polygon[index][0], polygon[index][1]
        x2, y2 = polygon[(index + 1) % count][0], polygon[(index + 1) % count][1]
        if ((y1 > y) != (y2 > y)) and (x < (x2 - x1) * (y - y1) / ((y2 - y1) or 1e-9) + x1):
            inside = not inside
    return inside


def _extract_site_boundary(raw_boundary: Any) -> list[list[float]]:
    if raw_boundary is None:
        return []
    boundary = raw_boundary
    if isinstance(boundary, dict):
        for key in ("boundary", "points", "vertices", "polyline"):
            if key in boundary:
                boundary = boundary[key]
                break
    if isinstance(boundary, list):
        points: list[list[float]] = []
        for item in boundary:
            if isinstance(item, (list, tuple)) and len(item) >= 2:
                points.append([float(item[0]), float(item[1])])
        return points
    return []


def _extract_tree_points(raw_trees: Any) -> list[list[float]]:
    if raw_trees is None:
        return []
    trees = raw_trees
    if isinstance(trees, dict):
        for key in ("trees", "points", "tree_points", "locations"):
            if key in trees:
                trees = trees[key]
                break
    if isinstance(trees, list):
        points: list[list[float]] = []
        for item in trees:
            if isinstance(item, (list, tuple)) and len(item) >= 2:
                points.append([float(item[0]), float(item[1])])
        return points
    return []


def _evaluate_candidate(shape: Any, site_boundary: list[list[float]], tree_points: list[list[float]]) -> tuple[float, dict[str, float]]:
    area = float(shape.metadata.get("area", 0.0) or 0.0)
    volume = float(shape.metadata.get("volume", 0.0) or 0.0)
    perimeter = float(shape.metadata.get("perimeter", 0.0) or 0.0)
    bbox = shape.metadata.get("bounding_box", {})
    min_pt = bbox.get("min", [0.0, 0.0, 0.0])
    max_pt = bbox.get("max", [0.0, 0.0, 0.0])

    score = area + volume * 0.05 - perimeter * 0.1
    penalties = 0.0

    if site_boundary:
        outside_count = 0
        for vertex in shape.vertices_2d:
            if not _point_in_polygon(vertex, site_boundary):
                outside_count += 1
        boundary_penalty = outside_count * 500.0
        penalties += boundary_penalty

    if tree_points:
        overlap_penalty = 0.0
        for tree_x, tree_y in tree_points:
            if min_pt[0] <= tree_x <= max_pt[0] and min_pt[1] <= tree_y <= max_pt[1]:
                overlap_penalty += 200.0
        penalties += overlap_penalty

    score -= penalties
    return score, {
        "area": area,
        "volume": volume,
        "perimeter": perimeter,
        "penalties": penalties,
        "score": score,
    }


def _build_mesh(rg_module: Any, vertices_3d: list[list[float]], face_indices: list[list[int]]) -> tuple[Any, int]:
    gh_mesh = rg_module.Mesh()
    for vertex in vertices_3d:
        gh_mesh.Vertices.Add(float(vertex[0]), float(vertex[1]), float(vertex[2]))

    face_count = 0
    for face in face_indices:
        if len(face) == 3:
            gh_mesh.Faces.AddFace(int(face[0]), int(face[1]), int(face[2]))
            face_count += 1
        elif len(face) == 4:
            gh_mesh.Faces.AddFace(int(face[0]), int(face[1]), int(face[2]), int(face[3]))
            face_count += 1
        elif len(face) > 4:
            for index in range(1, len(face) - 1):
                gh_mesh.Faces.AddFace(int(face[0]), int(face[index]), int(face[index + 1]))
                face_count += 1

    gh_mesh.Normals.ComputeNormals()
    gh_mesh.Compact()
    return gh_mesh, face_count


def load_shape_generator_module() -> Any:
    """Import or reload the VSCode shape generator module."""
    shape_module = importlib.import_module("shape_generator_node")
    return importlib.reload(shape_module)


def generate_shape_from_genes(generator: Any, genes: dict[str, Any], locked_shape_type: str | None, rng: random.Random) -> dict[str, Any]:
    """Create one candidate genes payload, respecting any typology lock."""
    return generator.generate_random_genes(
        shape_type=genes.get("shape_type"),
        locked_shape_type=locked_shape_type,
        overrides=genes,
        rng=rng,
    )


def apply_site_transform(shape: Any, genes: dict[str, Any]) -> Any:
    """Placeholder for site placement logic.

    The current generator already applies base_point and rotation inside the
    shape generator, so this function remains the hook for future site-specific
    transforms if you decide to add them later.
    """
    return shape


def convert_to_rhino_mesh(rg_module: Any, shape: Any) -> tuple[Any, int]:
    """Convert a generated shape into a Rhino mesh."""
    return _build_mesh(rg_module, shape.vertices_3d, shape.faces)


def run_generative_loop(
    rg_module: Any,
    generator: Any,
    seed_genes: dict[str, Any],
    seed_genes_obj: Any,
    iterations: int,
    locked_shape_type: str | None,
    site_boundary: list[list[float]],
    tree_points: list[list[float]],
    rng: random.Random,
) -> tuple[Any, Any, int, dict[str, Any], Any, dict[str, float]]:
    """Run the optimization loop and return the best mesh and metadata."""
    best_candidate = None
    best_mesh = None
    best_face_count = 0
    best_score = -1.0e18
    best_metrics: dict[str, float] = {}
    best_shape = None

    for _ in range(iterations):
        candidate_genes = generate_shape_from_genes(
            generator=generator,
            genes=seed_genes,
            locked_shape_type=locked_shape_type,
            rng=rng,
        )

        shape = generator.generate_from_genes(candidate_genes)
        shape = apply_site_transform(shape, candidate_genes)
        score, metrics = _evaluate_candidate(shape, site_boundary, tree_points)

        if best_candidate is None or score > best_score:
            best_candidate = candidate_genes
            best_score = score
            best_metrics = metrics
            best_mesh, best_face_count = convert_to_rhino_mesh(rg_module, shape)
            best_shape = shape

    if best_candidate is None or best_shape is None:
        raise RuntimeError("No valid candidates were generated")

    return best_mesh, best_shape, best_face_count, best_candidate, best_metrics, {"score": best_score}


try:
    py_folder = r"D:\3rd sem\STUDIO\AIA26_Studio - Copy (2)\team_04\PY"
    if py_folder not in sys.path:
        sys.path.insert(0, py_folder)

    rg = importlib.import_module("Rhino.Geometry")
    shape_module = load_shape_generator_module()
    ShapeGenerator = shape_module.ShapeGenerator
    ShapeGenes = shape_module.ShapeGenes

    rng = random.Random()
    seed_value = globals().get("seed")
    if seed_value is not None:
        try:
            rng.seed(int(seed_value))
        except Exception:
            rng.seed(str(seed_value))

    iterations_value = globals().get("iterations", 24)
    try:
        iterations = max(1, int(iterations_value))
    except Exception:
        iterations = 24

    raw_payload = globals().get("genes_json")
    if raw_payload is None:
        raw_payload = globals().get("genes")
    if raw_payload is None:
        raw_payload = globals().get("design_request")

    seed_genes = _coerce_payload(raw_payload)
    seed_genes_obj = ShapeGenes.from_dict(seed_genes)

    shape_lock = globals().get("locked_shape_type")
    if not shape_lock:
        shape_generation = _coerce_payload(globals().get("shape_generation"))
        shape_lock = shape_generation.get("locked_shape_type")
    if not shape_lock:
        shape_lock = seed_genes.get("shape_type")

    site_boundary = _extract_site_boundary(globals().get("site_boundary"))
    tree_points = _extract_tree_points(globals().get("tree_points"))

    generator = ShapeGenerator(shape_id_prefix="GH")
    best_mesh, best_shape, best_face_count, best_candidate, best_metrics, fitness_info = run_generative_loop(
        rg_module=rg,
        generator=generator,
        seed_genes=seed_genes,
        seed_genes_obj=seed_genes_obj,
        iterations=iterations,
        locked_shape_type=shape_lock,
        site_boundary=site_boundary,
        tree_points=tree_points,
        rng=rng,
    )

    mesh = best_mesh
    vertices = "%d vertices" % len(best_shape.vertices_3d)
    faces = "%d faces" % best_face_count
    genes_payload = json.dumps(best_candidate, indent=2)
    metadata = (
        "Shape: {shape_type}\n"
        "Iterations: {iterations}\n"
        "Locked shape: {locked_shape}\n"
        "Area: {area:.2f}\n"
        "Volume: {volume:.2f}\n"
        "Perimeter: {perimeter:.2f}\n"
        "Penalties: {penalties:.2f}\n"
        "Fitness: {score:.2f}"
    ).format(
        shape_type=best_shape.shape_type,
        iterations=iterations,
        locked_shape=shape_lock or "none",
        area=best_metrics.get("area", 0.0),
        volume=best_metrics.get("volume", 0.0),
        perimeter=best_metrics.get("perimeter", 0.0),
        penalties=best_metrics.get("penalties", 0.0),
        score=fitness_info.get("score", 0.0),
    )

except Exception as exc:
    import traceback

    error = "ERROR: %s\n\n%s" % (exc, traceback.format_exc())
    mesh = None
    vertices = None
    faces = None
    metadata = None
    genes_payload = None
# ---------- end script ----------
mesh_join = MeshJoin(Meshes=script.mesh)
panel = Panel(mesh_join)
script_2 = Script(
    site_crv=siteboundary,
    site_srf=surface,
    grid_pts=flatten_tree,
    building_mesh=flatten(mesh_join),
    road_crv=flatten(road),
    preferred_angle=Slider(90, range=0..100),
    iterations=read_json_value.AsNumber,
    tree_count=Slider(10, range=0..10),
    tree_radius=Slider(4, range=0..10),
    tree_height=Slider(9, range=0..10))  # -> best_building, best_trees, best_index, best_angle, best_score, record; inputs site_crv: Curve, site_srf: Surface, grid_pts: list of Point3d, building_mesh: list of Mesh, road_crv: Curve, preferred_angle: Double, iterations: Int32, tree_count: Int32, tree_radius: Int32, tree_height: Int32
# ---------- script_2: Python ----------
import Rhino.Geometry as rg
import rhinoscriptsyntax as rs
import random, math, json

# -----------------------
# SETTINGS
# -----------------------

def get_float(x, default):
    try:
        return float(x)
    except:
        return default

def get_int(x, default):
    try:
        return int(float(x))
    except:
        return default

iterations = get_int(iterations, 500)
preferred_angle = get_float(preferred_angle, 90.0)
tree_count = get_int(tree_count, 5)
tree_radius = get_float(tree_radius, 3.0)
tree_height = get_float(tree_height, 8.0)

if iterations < 1:
    iterations = 500

angles = [0, 45, 90, 135, 180, 225, 270, 315]
tol = 0.01

ROAD_WEIGHT = -1.0
SUN_WEIGHT = -1.0
OPEN_SPACE_WEIGHT = 1.0


# -----------------------
# CLEAN DATA
# -----------------------

def flatten_any(x):
    out = []

    if x is None:
        return out

    if hasattr(x, "Branches"):
        for b in x.Branches:
            out += flatten_any(b)
        return out

    if isinstance(x, (list, tuple)):
        for i in x:
            out += flatten_any(i)
        return out

    out.append(x)
    return out


def to_point3d(p):
    if isinstance(p, rg.Point3d):
        return p

    if isinstance(p, rg.Point):
        return p.Location

    try:
        cp = rs.coerce3dpoint(p)
        if cp:
            return cp
    except:
        pass

    if hasattr(p, "X") and hasattr(p, "Y") and hasattr(p, "Z"):
        return rg.Point3d(float(p.X), float(p.Y), float(p.Z))

    return None


def to_mesh(obj):
    if isinstance(obj, rg.Mesh):
        return obj.DuplicateMesh()

    if isinstance(obj, rg.Brep):
        meshes = rg.Mesh.CreateFromBrep(obj)
        if not meshes:
            return None

        joined = rg.Mesh()
        for m in meshes:
            joined.Append(m)

        joined.Normals.ComputeNormals()
        joined.Compact()
        return joined

    try:
        geo = rs.coercegeometry(obj)
        return to_mesh(geo)
    except:
        return None


def largest_mesh_piece(mesh):
    if mesh is None:
        return None

    pieces = mesh.SplitDisjointPieces()

    if pieces and len(pieces) > 0:
        largest = max(pieces, key=lambda m: m.Faces.Count)
        largest.Normals.ComputeNormals()
        largest.Compact()
        return largest.DuplicateMesh()

    mesh.Normals.ComputeNormals()
    mesh.Compact()
    return mesh.DuplicateMesh()


def get_single_building_mesh(x):
    """
    This fixes the 2-building output problem.
    Even if the input mesh contains 2 disconnected parts,
    only the largest connected mesh piece is used.
    """
    items = flatten_any(x)

    for item in items:
        m = to_mesh(item)
        if m:
            return largest_mesh_piece(m)

    return None


grid_pts_clean = []

for p in flatten_any(grid_pts):
    pt = to_point3d(p)
    if pt:
        grid_pts_clean.append(pt)

building_base = get_single_building_mesh(building_mesh)


# -----------------------
# SITE FUNCTIONS
# -----------------------

def point_inside_site_xy(pt):
    if site_crv is None:
        return False

    test = rg.Point3d(pt.X, pt.Y, 0)
    result = site_crv.Contains(test, rg.Plane.WorldXY, tol)

    return result != rg.PointContainment.Outside


def get_site_z_point(pt):
    test = rg.Point3d(pt.X, pt.Y, pt.Z)

    if site_srf is not None:
        try:
            if isinstance(site_srf, rg.Brep):
                result = site_srf.ClosestPoint(test)
                if isinstance(result, tuple) and result[0]:
                    return result[1]

            elif isinstance(site_srf, rg.Surface):
                ok, u, v = site_srf.ClosestPoint(test)
                if ok:
                    return site_srf.PointAt(u, v)

            elif isinstance(site_srf, rg.Mesh):
                mp = site_srf.ClosestMeshPoint(test, 999999)
                if mp:
                    return mp.Point
        except:
            pass

    return test


def mesh_inside_site(mesh):
    if mesh is None:
        return False

    for v in mesh.Vertices:
        pt = rg.Point3d(v.X, v.Y, 0)

        if not point_inside_site_xy(pt):
            return False

    return True


def tree_circle_inside_site(pt, radius):
    for i in range(24):
        a = 2.0 * math.pi * i / 24.0

        check_pt = rg.Point3d(
            pt.X + math.cos(a) * radius,
            pt.Y + math.sin(a) * radius,
            0
        )

        if not point_inside_site_xy(check_pt):
            return False

    return True


# -----------------------
# BUILDING FUNCTIONS
# -----------------------

def move_mesh_to_point(mesh, target):
    m = mesh.DuplicateMesh()
    bbox = m.GetBoundingBox(True)

    base = rg.Point3d(
        (bbox.Min.X + bbox.Max.X) / 2.0,
        (bbox.Min.Y + bbox.Max.Y) / 2.0,
        bbox.Min.Z
    )

    target = get_site_z_point(target)

    vec = rg.Vector3d(
        target.X - base.X,
        target.Y - base.Y,
        target.Z - base.Z
    )

    m.Transform(rg.Transform.Translation(vec))
    return m


def rotate_mesh(mesh, angle):
    m = mesh.DuplicateMesh()
    bbox = m.GetBoundingBox(True)

    center = rg.Point3d(
        (bbox.Min.X + bbox.Max.X) / 2.0,
        (bbox.Min.Y + bbox.Max.Y) / 2.0,
        bbox.Min.Z
    )

    xform = rg.Transform.Rotation(
        math.radians(float(angle)),
        rg.Vector3d.ZAxis,
        center
    )

    m.Transform(xform)
    return m


def road_distance(mesh):
    if road_crv is None:
        return 0.0

    center = mesh.GetBoundingBox(True).Center
    ok, t = road_crv.ClosestPoint(center)

    if not ok:
        return 999999.0

    return center.DistanceTo(road_crv.PointAt(t))


def open_space_score(mesh):
    if site_crv is None:
        return 0.0

    center = mesh.GetBoundingBox(True).Center
    ok, t = site_crv.ClosestPoint(center)

    if not ok:
        return 0.0

    return center.DistanceTo(site_crv.PointAt(t))


def sun_diff(angle):
    d = abs(float(angle) - preferred_angle)
    return min(d, 360.0 - d)


def building_fitness(mesh, angle):
    score = 0.0
    score += road_distance(mesh) * ROAD_WEIGHT
    score += open_space_score(mesh) * OPEN_SPACE_WEIGHT
    score += sun_diff(angle) * SUN_WEIGHT
    return score


# -----------------------
# TREE FUNCTIONS
# -----------------------

def create_tree(pt):
    base_pt = get_site_z_point(pt)

    plane = rg.Plane(base_pt, rg.Vector3d.ZAxis)
    circle = rg.Circle(plane, tree_radius)
    cylinder = rg.Cylinder(circle, tree_height)

    return rg.Brep.CreateFromCylinder(cylinder, True, True)


def tree_clear_from_building(pt, mesh):
    if mesh is None:
        return False

    bbox = mesh.GetBoundingBox(True)
    safe_radius = tree_radius * 2.0

    minx = bbox.Min.X - safe_radius
    maxx = bbox.Max.X + safe_radius
    miny = bbox.Min.Y - safe_radius
    maxy = bbox.Max.Y + safe_radius

    if minx <= pt.X <= maxx and miny <= pt.Y <= maxy:
        return False

    test_pt = rg.Point3d(pt.X, pt.Y, pt.Z)

    try:
        mp = mesh.ClosestMeshPoint(test_pt, safe_radius)

        if mp:
            closest = mp.Point
            dist = test_pt.DistanceTo(closest)

            if dist < safe_radius:
                return False
    except:
        pass

    return True


def tree_tree_clear(pt, existing_pts):
    min_dist = tree_radius * 2.3

    for p in existing_pts:
        if pt.DistanceTo(p) < min_dist:
            return False

    return True


# -----------------------
# VALID GRID POINTS
# -----------------------

valid_pts = []

for pt in grid_pts_clean:
    if point_inside_site_xy(pt):
        valid_pts.append(get_site_z_point(pt))


# -----------------------
# FIND BEST BUILDING
# -----------------------

best_building = None
best_index = -1
best_angle = 0.0
best_score = -1e18

checked = 0
valid_buildings = 0

if site_crv and building_base and len(valid_pts) > 0:

    for i in range(iterations):

        idx = random.randint(0, len(valid_pts) - 1)
        angle = random.choice(angles)

        moved = move_mesh_to_point(building_base, valid_pts[idx])
        rotated = rotate_mesh(moved, angle)

        checked += 1

        if not mesh_inside_site(rotated):
            continue

        valid_buildings += 1
        score = building_fitness(rotated, angle)

        if score > best_score:
            best_score = score
            best_building = largest_mesh_piece(rotated)
            best_index = idx
            best_angle = angle


# -----------------------
# PLACE TREES
# -----------------------

best_trees = []
tree_pts = []

if best_building is not None:

    ids = list(range(len(valid_pts)))
    random.shuffle(ids)

    for idx in ids:

        if len(best_trees) >= tree_count:
            break

        if idx == best_index:
            continue

        pt = valid_pts[idx]

        if not tree_circle_inside_site(pt, tree_radius):
            continue

        if not tree_clear_from_building(pt, best_building):
            continue

        if not tree_tree_clear(pt, tree_pts):
            continue

        tree_pts.append(pt)
        best_trees.append(create_tree(pt))


# -----------------------
# FINAL OUTPUT
# -----------------------

if best_building is not None:
    best_building = largest_mesh_piece(best_building)

else:
    best_building = None
    best_trees = []
    tree_pts = []
    best_index = -1
    best_angle = 0.0
    best_score = -999999.0


record = json.dumps({
    "best_grid_index": int(best_index),
    "best_rotation_angle": float(best_angle),
    "best_fitness_score": float(best_score),
    "checked_options": int(checked),
    "valid_inside_buildings": int(valid_buildings),
    "valid_grid_point_count": int(len(valid_pts)),
    "trees_created": int(len(best_trees)),
    "requested_tree_count": int(tree_count),
    "tree_radius": float(tree_radius),
    "tree_height": float(tree_height),
    "note": "Building output is forced to one largest connected mesh piece."
}, indent=4)
# ---------- end script_2 ----------
panel_2 = Panel(script_2.best_building)
mesh = Mesh(script_2.best_building)
list_item_2 = ListItem(List=script_2.record, Index=0, Wrap=True)
panel_3 = Panel(script_2.record)
list_item_3 = ListItem(List=mesh, Index=0, Wrap=True)
mesh_2 = Mesh(script_2.best_trees)
create_json_value = CreateJSONValue(Value=list_item_2)
create_json_object = CreateJSONObject(Keys="parametric_shape_generator", Values=create_json_value)
mcp_tool_response = MCPToolResponse(Request=deconstruct_tool_call.Request, Content=create_json_object, IsError=False)
or = GateOr(A=mcp_tool_response)
tool_call_success = ClusterOutput(or)

# ==== cluster Team04DefinitionCluster

# ----
# Team 04 Definition Cluster
# CYLINDER TEAM
# Tool 02
panel = Panel("Name of the project site")
# Tool 01
panel_2 = Panel("Site boundary coordinates as text list")
panel_3 = Panel("Reads a closed site boundary curve and returns the site area and boundary coordinates as JSON")
param = DefineToolParameter(Name="site_name", Type="string", Description=panel, Required=Toggle(True))
param_2 = DefineToolParameter(Name="site_curve", Type="string", Description=panel_2, Required=Toggle(True))
merge = Merge(Data1=param_2, Data2=param)
tool = DefineTool(Name="site_boundary_reader_04", Description=panel_3, Parameters=merge)

define_tool_parameter = DefineToolParameter(Name="site_area", Type="number", Description="total area of the site", Required=Toggle(True))

panel_4 = Panel("Generates a simple parametric building mass based on width, depth, height, and shape type")
# Tool 03
panel_5 = Panel("Building depth")
param_3 = DefineToolParameter(Name="depth", Type="number", Description=panel_5, Required=Toggle(True))
param_4 = DefineToolParameter(Name="width", Type="number", Description="Building width", Required=Toggle(True))
merge_2 = Merge(Data1=param_4, Data2=param_3)
tool_2 = DefineTool(Name="parametric_shape_generator_04", Description=panel_4, Parameters=merge_2)

# ----
# Tool 05
toggle = BooleanToggle(True)

# ----
# Tool 04
panel_6 = Panel("This tool deletes a room by giving it a room name and the layout json")
param_5 = DefineToolParameter(Name="site_json", Type="string", Description="JSON output from site_boundary_reader_04", Required=Toggle(True))
param_6 = DefineToolParameter(Name="shape_json", Type="string", Description="JSON output from parametric_shape_generator_04", Required=Toggle(True))
param_7 = DefineToolParameter(Name="fit_json", Type="string", Description="JSON output from site_fit_checker_04", Required=toggle)
merge_3 = Merge(Data1=param_5, Data2=param_6, Data3=param_7)
tool_3 = DefineTool(Name="basic_site_evaluator_04", Description=panel_6, Parameters=merge_3)

# ----
# Tool 06
panel_7 = Panel("number")
define_tool_parameter_2 = DefineToolParameter(Name="number_of_trees", Type="number", Description="number of trees in the site", Required=Toggle(True))
define_tool_parameter_3 = DefineToolParameter(Name="number_of_sides_of_site", Type=panel_7, Description="the number os sides of the site ", Required=Toggle(True))
define_tool_parameter_4 = DefineToolParameter(Name="radius_of_trees", Type="number", Description="The Radius of a Tree in the site", Required=Toggle(True))
merge_4 = Merge(Data1=define_tool_parameter_2, Data2=define_tool_parameter_4, Data3=define_tool_parameter_3, Data4=define_tool_parameter)

panel_8 = Panel("Site boundary geometry used for placement and constraint checking. Defines the allowable region for building and tree generation.")
panel_9 = Panel("Number of generative design candidates evaluated during optimization. Higher values increase exploration quality but also increase computation time.")

panel_10 = Panel("Checks whether the generated building footprint fits inside the site boundary")
param_8 = DefineToolParameter(Name="site_json", Type="string", Description="JSON output from site_boundary_reader_04", Required=Toggle(True))
param_9 = DefineToolParameter(Name="shape_json", Type="string", Description="JSON output from parametric_shape_generator_04", Required=Toggle(True))
merge_5 = Merge(Data1=param_8, Data2=param_9)
tool_4 = DefineTool(Name="site_fit_checker_04", Description=panel_10, Parameters=merge_5)

panel_11 = Panel("Existing or generated tree locations used for environmental constraints, overlap checking, shading analysis, and landscape optimization.")
panel_12 = Panel("Random seed value used to reproduce the same generative results consistently across runs. Changing the seed creates different design variations.")
panel_13 = Panel("Total number of trees to populate within the site boundary. Controls vegetation density.")
panel_14 = Panel("Total number of trees to populate within the site boundary. Controls vegetation density.")
panel_15 = Panel("Optional building typology lock. Example values: h_shape, l_shape, u_shape, courtyard, tower. When connected, the system only generates variations of this selected shape type.")
panel_16 = Panel("JSON data coming from VS Code or MCP containing all generated gene values for the building configuration, optimization parameters, and generative rules.")
panel_17 = Panel("Generates procedural site boundaries using area, proportion, distortion, subdivision, and rotation parameters.")
define_tool_parameter_5 = DefineToolParameter(Name="number_of_trees", Type="number", Description=panel_13, Required=Toggle(True))
define_tool_parameter_6 = DefineToolParameter(Name="radius_of_trees", Type="number", Description=panel_14, Required=Toggle(True))
define_tool_parameter_7 = DefineToolParameter(Name="locked_shape_type", Type="Text", Description=panel_15, Required=Toggle(True))
define_tool_parameter_8 = DefineToolParameter(Name="site_boundary", Type="Curve / Polyline / Point List", Description=panel_8, Required=Toggle(True))
define_tool_parameter_9 = DefineToolParameter(Name="iterations", Type="Integer / Number", Description=panel_9, Required=Toggle(True))
define_tool_parameter_10 = DefineToolParameter(Name="genes_json", Type="Text / JSON String", Description=panel_16, Required=Toggle(True))
define_tool_parameter_11 = DefineToolParameter(Name="tree_points", Type="Point List", Description=panel_11, Required=Toggle(True))
define_tool_parameter_12 = DefineToolParameter(Name="seed", Type="Integer", Description=panel_12, Required=Toggle(True))
merge_6 = Merge(Data1=define_tool_parameter_5, Data2=define_tool_parameter_6)
merge_7 = Merge(
    Data1=define_tool_parameter_10,
    Data2=define_tool_parameter_7,
    Data3=define_tool_parameter_8,
    Data4=define_tool_parameter_11,
    Data5=define_tool_parameter_9,
    Data6=define_tool_parameter_12)
define_tool = DefineTool(Name="area_of_the_compute_site", Description="area of site after compute", Parameters=merge_4)
define_tool_2 = DefineTool(Name="site_placement_optimizer", Description="area of Usable site area", Parameters=merge_6)
define_tool_3 = DefineTool(Name="parametric_shape_generator", Description=panel_17, Parameters=merge_7)
merge_8 = Merge(Data1=tool, Data2=tool_2, Data3=tool_4, Data4=tool_3, Data5=define_tool)
merge_9 = Merge(Data1=define_tool_3)
result = ClusterOutput(merge_9)
panel_18 = Panel(merge_9)
