# Grasshopper definition test.gh (Grasshopper 1.0.8)
# plug-ins: Swiftlet

define_tool_parameter = DefineToolParameter(Name="layer_name", Type="string", Required=True)
define_tool_parameter_2 = DefineToolParameter(Name="geometry_id", Type="string", Required=True)
define_tool_parameter_3 = DefineToolParameter(Name="boundary", Type="array of `[x, y, z]` points", Required=True)
define_tool_parameter_4 = DefineToolParameter(Name="shape_type", Type="string", Required=True)
define_tool_parameter_5 = DefineToolParameter(Name="closed", Type="boolean", Required=True)
panel = Panel("Create Rhino/Grasshopper geometry from a Python-generated closed building boundary.")
define_tool = DefineTool(
    Name="import_building_boundary_04",
    Description=panel,
    Parameters=[define_tool_parameter_2, define_tool_parameter_3, define_tool_parameter_4, define_tool_parameter, define_tool_parameter_5])
mcp_server = MCPServer(Port=3001, Tools=define_tool, ServerName="Swiftlet")
deconstruct_tool_call = DeconstructToolCall(Request=mcp_server)  # -> Request, Tool, Arguments
get_json_object_key = GetJSONObjectKey(JObject=deconstruct_tool_call.Arguments, Key="boundary")
read_json_array = ReadJSONArray(Array=get_json_object_key)
read_json_array_2 = ReadJSONArray(Array=read_json_array)
read_json_value = ReadJSONValue(JValue=read_json_array_2)  # -> AsString, AsNumber, AsBool
list_item = ListItem(List=read_json_value.AsString, Index=0, Wrap=True)  # -> Item, Item1, Item2
construct_point = ConstructPoint(XCoordinate=list_item.Item, YCoordinate=list_item.Item1, ZCoordinate=list_item.Item2)
polyline = PolyLine(Vertices=flatten(construct_point), Closed=False)
area = Area(Geometry=polyline)  # -> Area, Centroid
create_json_value = CreateJSONValue(Value=area.Area)
create_json_object = CreateJSONObject(Keys="area", Values=create_json_value)
mcp_tool_response = MCPToolResponse(Request=deconstruct_tool_call.Request, Content=create_json_object, IsError=False)
panel_2 = Panel(area.Area)
panel_3 = Panel(mcp_tool_response)
