# Grasshopper definition team_05_working.gh (Grasshopper 1.0.8)
# plug-ins: Swiftlet

# ----
# Connect MCP Tools to Decall and Update All Clusters
button = Button()
# IF SOMETHING IS NOT
# WORKING PRESS THIS
# BUTTON FIRST
toggle = BooleanToggle(True)
connect_mcp_tools_to_decall = CSharpScript(nickname_From="Central MCP Server", nickname_To="Central DeCall", connect=button)  # -> out; inputs nickname_From: String, nickname_To: String, connect: Boolean
# ---------- connect_mcp_tools_to_decall: C# ----------
using System;
using System.Linq;
using Grasshopper;
using Grasshopper.Kernel;

public class Script_Instance : GH_ScriptInstance
{
    private void RunScript(string nickname_From, string nickname_To, bool connect)
    {
        if (!connect) return;
        Console.Write($"Attempting to connect outputs from '{nickname_From}' to '{nickname_To}'...");

        var ghDoc = Instances.ActiveCanvas?.Document;
        if (ghDoc == null) return;

        var compFrom = ghDoc.Objects
            .OfType<IGH_Component>()
            .FirstOrDefault(o => o.NickName == nickname_From);

        var compTo = ghDoc.Objects
            .OfType<IGH_Param>()
            .FirstOrDefault(o => o.NickName == nickname_To);

        if (compFrom != null && compTo != null)
        {
            ghDoc.ScheduleSolution(5, doc => Connect(doc, compFrom, compTo));
        }
    }

    // <Custom additional code> 
    private void Connect(GH_Document doc, IGH_Component compFrom, IGH_Param compTo)
    {
        if (compFrom == null || compTo == null) return;

        foreach (IGH_Param param in compFrom.Params.Output)
        {
            compTo.AddSource(param);
        }
    }
}
# ---------- end connect_mcp_tools_to_decall ----------
update_all_clusters = CSharpScript(update=button, recursive=toggle)  # -> out, A; inputs update: Boolean, recursive: Boolean, passwords: list of String, localPath: String
# ---------- update_all_clusters: C# ----------
using System;
using System.Collections;
using System.Collections.Generic;

using Rhino;
using Rhino.Geometry;

using Grasshopper;
using Grasshopper.Kernel;
using Grasshopper.Kernel.Data;
using Grasshopper.Kernel.Types;
using System.Windows.Forms;
using System.Linq;
/// <summary>
/// This class will be instantiated on demand by the Script component.
/// </summary>
public class Script_Instance : GH_ScriptInstance
{
  /// <summary>Print a String to the [Out] Parameter of the Script component.</summary>
  /// <param name="text">String to print.</param>
  private void Print(string text) { /* Implementation hidden. */ }
  /// <summary>Print a formatted String to the [Out] Parameter of the Script component.</summary>
  /// <param name="format">String format.</param>
  /// <param name="args">Formatting parameters.</param>
  private void Print(string format, params object[] args) { /* Implementation hidden. */ }
  /// <summary>Print useful information about an object instance to the [Out] Parameter of the Script component. </summary>
  /// <param name="obj">Object instance to parse.</param>
  private void Reflect(object obj) { /* Implementation hidden. */ }
  /// <summary>Print the signatures of all the overloads of a specific method to the [Out] Parameter of the Script component. </summary>
  /// <param name="obj">Object instance to parse.</param>
  private void Reflect(object obj, string method_name) { /* Implementation hidden. */ }

  /// <summary>Gets the current Rhino document.</summary>
  private readonly RhinoDoc RhinoDocument;
  /// <summary>Gets the Grasshopper document that owns this script.</summary>
  private readonly GH_Document GrasshopperDocument;
  /// <summary>Gets the Grasshopper script component that owns this script.</summary>
  private readonly IGH_Component Component;
  /// <summary>
  /// Gets the current iteration count. The first call to RunScript() is associated with Iteration==0.
  /// Any subsequent call within the same solution will increment the Iteration count.
  /// </summary>
  private readonly int Iteration;

  /// <summary>
  /// This procedure contains the user code. Input parameters are provided as regular arguments,
  /// Output parameters as ref arguments. You don't have to assign output parameters,
  /// they will have a default value.
  /// </summary>
  private void RunScript(
		bool update,
		bool recursive,
		List<string> passwords,
		string localPath,
		ref object A)
  {

    A = updateLog;
    if (update)
    {
      updateLog = new List<string>();
      _passwords = passwords;
      UpdateClusters(GrasshopperDocument, recursive, localPath);
    }

  }

  // <Custom additional code> 
  List<string> updateLog;
  List<String> _passwords;

  void UpdateClusters (GH_Document ghDoc, bool recursive, string localPath)
  {
    foreach (var obj in ghDoc.Objects)
    {
      var cluster = obj as Grasshopper.Kernel.Special.GH_Cluster;
      if (cluster != null)
      {
        var clusterPath = cluster.FilePath;
        if (!string.IsNullOrEmpty(clusterPath))
        {
          if (cluster.Synchronisation == Grasshopper.Kernel.Special.GH_Synchronisation.OutOfDate)
          {
            cluster.CreateFromFilePath(clusterPath);
            updateLog.Add("Updated: " + clusterPath);
          }
          else if (cluster.Synchronisation == Grasshopper.Kernel.Special.GH_Synchronisation.MissingReference)
          {
            string newPath = ReplacePath(localPath, clusterPath);
            if (!string.IsNullOrEmpty(newPath))
            {
              cluster.CreateFromFilePath(newPath);
              updateLog.Add("Replaced and updated: " + newPath);
            }
            else
            {
              updateLog.Add("Missing reference: " + clusterPath);
            }

          }
        }

        //Update recursively
        if (recursive)
        {
          GH_Document clusterDoc = GetClusterDoc(cluster);
          if (clusterDoc != null)
            UpdateClusters(clusterDoc, recursive, localPath);
        }
      }
    }
  }

  GH_Document GetClusterDoc(Grasshopper.Kernel.Special.GH_Cluster cluster)
  {
    //no pass needed
    var doc = cluster.Document(string.Empty);
    if (doc != null)
      return doc;

    //try passwords
    if (_passwords != null && _passwords.Any())
    {
      foreach (var pass in _passwords)
      {
        doc = cluster.Document(pass);
        if (doc != null)
          return doc;
      }
    }

    return null;
  }

  string ReplacePath(string localPath, string missingPath)
  {
    if (String.IsNullOrEmpty(missingPath) || string.IsNullOrEmpty(localPath))
      return null;
    else
    {
      string lastLocalPart = localPath.Split('\\').Last();
      string[] parts = missingPath.Split('\\');
      if (parts.Contains(lastLocalPart))
      {
        int i = Array.IndexOf(parts, lastLocalPart);
        string clusterPath = String.Join("\\", parts.Skip(i + 1));
        string result = String.Join("\\", localPath, clusterPath);
        return result;
      }
      else
        return null;
    }
  }
  // </Custom additional code> 
}
# ---------- end update_all_clusters ----------
panel = Panel(connect_mcp_tools_to_decall)

team_05_definition_cluster = Team05DefinitionCluster()
c_script = CSharpScript()  # -> out, availablePort
# ---------- c_script: C# ----------
// Grasshopper Script Instance
// This script finds an available port on the local machine.
#region Usings
using System;
using System.Linq;
using System.Collections;
using System.Collections.Generic;
using System.Drawing;
using System.Net;
using System.Net.Sockets;

using Rhino;
using Rhino.Geometry;

using Grasshopper;
using Grasshopper.Kernel;
using Grasshopper.Kernel.Data;
using Grasshopper.Kernel.Types;
#endregion

public class Script_Instance : GH_ScriptInstance
{
    #region Notes
    /* 
      Members:
        RhinoDoc RhinoDocument
        GH_Document GrasshopperDocument
        IGH_Component Component
        int Iteration

      Methods (Virtual & overridable):
        Print(string text)
        Print(string format, params object[] args)
        Reflect(object obj)
        Reflect(object obj, string method_name)
    */
    #endregion

    private void RunScript(object start, object end, ref object availablePort)
    {
        // Use default values if parameters are not provided
        int startPort = (start != null && int.TryParse(start.ToString(), out int s)) ? s : 3001;
        int endPort = (end != null && int.TryParse(end.ToString(), out int e)) ? e : 3100;

        // Find an available port in the specified range
        try
        {
            availablePort = FindAvailablePortInRange(startPort, endPort);
            Print($"Available port found: {availablePort}");
        }
        catch (Exception ex)
        {
            Print($"Error: {ex.Message}");
            availablePort = null;
        }
    }

    /// <summary>
    /// Checks if a local TCP port is available for binding (i.e., not in use).
    /// Returns True if available, False otherwise.
    /// </summary>
    private bool IsPortAvailableForBind(int port)
    {
        try
        {
            // Create a new TCP socket
            using (Socket socket = new Socket(AddressFamily.InterNetwork, SocketType.Stream, ProtocolType.Tcp))
            {
                // Try to bind to the port on all interfaces (0.0.0.0)
                socket.Bind(new IPEndPoint(IPAddress.Any, port));
                // If successful, the socket is closed by the using statement and return True
                return true;
            }
        }
        catch (SocketException)
        {
            // If binding fails, it means the port is already in use
            return false;
        }
    }

    /// <summary>
    /// Finds an available port by letting the OS assign one.
    /// </summary>
    private int FindAvailablePort()
    {
        Socket socket = new Socket(AddressFamily.InterNetwork, SocketType.Stream, ProtocolType.Tcp);
        socket.Bind(new IPEndPoint(IPAddress.Any, 0)); // Bind to an available port assigned by the OS
        int availablePort = ((IPEndPoint)socket.LocalEndPoint).Port; // Get the assigned port number
        socket.Close(); // Close the socket
        return availablePort;
    }

    /// <summary>
    /// Finds the first available port in a given range.
    /// </summary>
    private int FindAvailablePortInRange(int start = 3001, int end = 3100)
    {
        for (int port = start; port <= end; port++)
        {
            if (IsPortAvailableForBind(port))
                return port;
        }
        throw new Exception($"No available ports found in the range {start}-{end}.");
    }
}
# ---------- end c_script ----------
central_mcp_server = MCPServer(Port=c_script.availablePort, Tools=team_05_definition_cluster, ServerName="Swiftlet")  # -> Compute_volume_of_cube, Count_elements_by_type, Get_wall_geometry, Get_flooring_cost, Get_ceiling_cost
panel_2 = Panel(c_script.availablePort)
get_tool_names = CSharpScript(x=team_05_definition_cluster)  # -> flatten(out)
# ---------- get_tool_names: C# ----------
// Grasshopper Script Instance
#region Usings
using System;
using System.Linq;
using System.Collections;
using System.Collections.Generic;
using System.Drawing;

using Rhino;
using Rhino.Geometry;

using Grasshopper;
using Grasshopper.Kernel;
using Grasshopper.Kernel.Data;
using Grasshopper.Kernel.Types;
#endregion

public class Script_Instance : GH_ScriptInstance
{
    #region Notes
    /* 
      Members:
        RhinoDoc RhinoDocument
        GH_Document GrasshopperDocument
        IGH_Component Component
        int Iteration

      Methods (Virtual & overridable):
        Print(string text)
        Print(string format, params object[] args)
        Reflect(object obj)
        Reflect(object obj, string method_name)
    */
    #endregion

    private void RunScript(object x)
    {
        dynamic dynamicX = x;
        Console.Write(dynamicX.Name);
    }
}
# ---------- end get_tool_names ----------
central_decall = Data([central_mcp_server.Compute_volume_of_cube, central_mcp_server.Count_elements_by_type, central_mcp_server.Get_wall_geometry])
clean = CleanTree(RemoveNulls=True, RemoveInvalid=True, RemoveEmpty=False, Tree=central_decall)
team_05_result_cluster = Team05ResultCluster(tool_call_request=clean)  # -> tool_names_3, tool_call_success

# ----
# Tool Names from the Results Clusters
# Tool Names from the Definition Clusters
# These Two Clusters should be EXACTLY THE SAME
panel_3 = Panel(get_tool_names)
panel_4 = Panel(team_05_result_cluster.tool_names_3)

rec = DataRecorder(team_05_result_cluster.tool_call_success, DataLimit=-10, RecordData=True)
rec_2 = DataRecorder(clean, DataLimit=-10, RecordData=True)

# ---- group: Request Parameters
decall = DeconstructToolCall(Request=clean)  # -> Request, Tool, Arguments
rjo = ReadJSONObject(JObject=decall.Arguments)  # -> Keys, JTokens
# Debug: Check request input data
panel_5 = Panel("room_name")
tmatch = MatchText(Text=rjo.Keys, Pattern=panel_5, Case=True)
tmatch_2 = MatchText(Text=rjo.Keys, Pattern="layout_json", Case=True)
dispatch = Dispatch(List=rjo.JTokens, DispatchPattern=tmatch)  # -> ListA, ListB
dispatch_2 = Dispatch(List=rjo.JTokens, DispatchPattern=tmatch_2)  # -> ListA, ListB
panel_6 = Panel(dispatch.ListA)
panel_7 = Panel(dispatch_2.ListA)

# ----
response_ok = Panel(rec)
called_tool_name = Panel(rec_2)

# ----
# Debug Tool Names
# This Panel should always be TRUE
tool_names_from_the_results_clusters = Data(panel_4)
tool_names_from_the_definition_clusters = Data(panel_3)
join = TextJoin(Text=flatten(tool_names_from_the_definition_clusters))
join_2 = TextJoin(Text=flatten(tool_names_from_the_results_clusters))
tstat = TreeStatistics(Tree=tool_names_from_the_definition_clusters)  # -> Paths, Length, Count
tstat_2 = TreeStatistics(Tree=tool_names_from_the_results_clusters)  # -> Paths, Length, Count
dpath = DeconstructPath(Branch=tstat.Paths)
dpath_2 = DeconstructPath(Branch=tstat_2.Paths)
equals = Equality(FirstNumber=tstat.Length, SecondNumber=tstat_2.Length)  # -> Equality, Inequality
equals_2 = Equality(FirstNumber=tstat.Count, SecondNumber=tstat_2.Count)  # -> Equality, Inequality
ma = MassAddition(Input=flatten(equals.Equality))  # -> Result, PartialResults
equals_3 = Equality(FirstNumber=dpath, SecondNumber=dpath_2)  # -> Equality, Inequality
lng = ListLength(List=equals.Equality)
ma_2 = MassAddition(Input=flatten(equals_3.Inequality))  # -> Result, PartialResults
equals_4 = Equality(FirstNumber=ma.Result, SecondNumber=lng)  # -> Equality, Inequality
does_quantity_of_tools_match = Panel(equals_2.Equality)
equals_5 = Equality(FirstNumber=ma_2.Result, SecondNumber="0")  # -> Equality, Inequality
does_quantity_of_tools_match_per_team = Panel(equals_4.Equality)
are_all_teams_included = Panel(equals_5.Equality)

tmatch_3 = MatchText(Text=join, Pattern=join_2, Case=True)

do_all_names_match = Panel(tmatch_3)
and = GateAnd(A=equals_5.Equality, B=equals_4.Equality, C=equals_2.Equality, D=tmatch_3)  # -> flatten(Result)
do_trees_match = Panel(and)

# ==== cluster Team05DefinitionCluster

# ----
# Team 05 Definition Cluster
# CUBE TEAM
panel = Panel("This tool computes the volume of a cube by giving it a length of a side.  The output unit is the input unit cubed.")
param = DefineToolParameter(Name="length", Type="number", Description="The Radius of a Cube", Required=Toggle(True))
merge = Merge(Data1=param)
tool = DefineTool(Name="compute_volume_of_cube", Description=panel, Parameters=merge)

# ----
# GET WALL GEOMETRY
panel_2 = Panel("This tools gets the wall geometry information inside the model and returns a json file")
toggle = BooleanToggle(True)
param_2 = DefineToolParameter(Name="type", Type="string", Description="The thickness of the wall", Required=Toggle(True))
param_3 = DefineToolParameter(Name="thickness", Type="number", Description="The thickness of the wall", Required=Toggle(True))
param_4 = DefineToolParameter(Name="width", Type="number", Description="the width of the wall", Required=Toggle(True))
param_5 = DefineToolParameter(Name="heigth", Type="number", Description="The heigth of the wall", Required=Toggle(True))
param_6 = DefineToolParameter(Name="length", Type="number", Description="The length of the wall", Required=Toggle(True))
merge_2 = Merge(Data1=param_4, Data2=param_6, Data3=param_5, Data4=param_3, Data5=param_2)
tool_2 = DefineTool(Name="get_wall_geometry", Description=panel_2, Parameters=merge_2)

# ----
# COUNT ELEMENTS BY TYPE
panel_3 = Panel("This tool counts how many doors and windows of a curtain type are there in a layout ")
param_7 = DefineToolParameter(Name="door_count", Type="number", Description="how many doors are there", Required=Toggle(True))
param_8 = DefineToolParameter(Name="door_type", Type="string", Description="what type the doors is", Required=Toggle(True))
param_9 = DefineToolParameter(Name="window_count", Type="number", Description="how many windows are there", Required=Toggle(True))
param_10 = DefineToolParameter(Name="window_type", Type="string", Description="what type the window is", Required=Toggle(True))
merge_3 = Merge(Data1=param_7, Data2=param_8, Data3=param_9, Data4=param_10)
tool_3 = DefineTool(Name="count_elements_by_type", Description=panel_3, Parameters=merge_3)

# ----
# GET_FLOORING_COST
panel_4 = Panel("This tool computes the cost of the flooring")
param_11 = DefineToolParameter(Name="cost_per_m2", Type="number", Description="the cost of the material", Required=Toggle(True))
param_12 = DefineToolParameter(Name="room_id", Type="string", Description="the calculated room", Required=Toggle(True))
param_13 = DefineToolParameter(Name="area", Type="number", Description="the area of the room", Required=Toggle(True))
param_14 = DefineToolParameter(Name="material", Type="string", Description="the type of the material", Required=Toggle(True))
merge_4 = Merge(Data1=param_14, Data2=param_13, Data3=param_12, Data4=param_11)
tool_4 = DefineTool(Name="get_flooring_cost", Description=panel_4, Parameters=merge_4)

# ----
# GET_MATERIAL_UNIT_COST
panel_5 = Panel("This tool gives information about the material")
param_15 = DefineToolParameter(Name="grade", Type="string", Description="the grade of the material", Required=Toggle(True))
param_16 = DefineToolParameter(Name="material_type", Type="string", Description="the type of the material", Required=Toggle(True))
merge_5 = Merge(Data1=param_16, Data2=param_15)
tool_5 = DefineTool(Name="get_ceiling_cost", Description=panel_5, Parameters=merge_5)

# ----
# GET_CEILING_COST
panel_6 = Panel("This tool computes the cost of the flooring")
param_17 = DefineToolParameter(Name="area", Type="number", Description="the area of the room", Required=Toggle(True))
param_18 = DefineToolParameter(Name="material", Type="string", Description="the type of the material", Required=Toggle(True))
param_19 = DefineToolParameter(Name="cost_per_m2", Type="number", Description="the cost of the material", Required=Toggle(True))
merge_6 = Merge(Data1=param_18, Data2=param_17, Data3=param_19)
tool_6 = DefineTool(Name="get_ceiling_cost", Description=panel_6, Parameters=merge_6)

merge_7 = Merge(Data1=tool, Data2=tool_2, Data3=tool_3, Data4=tool_4, Data5=tool_6, Data6=tool_5)
R = ClusterOutput(merge_7)

# ==== cluster Team05ResultCluster

# ----
# Team 05 Result Cluster
# CUBE TEAM
# Edit Tool Names to
# Match Definition Cluster
tool_names = Panel("""compute_volume_of_cube
get_wall_geometry
count_elements_by_type
get_flooring_cost
get_ceiling_cost
get_material_unit_cost""")

# ----
# Sorting Logic, Please Do Not Edit
tool_call_request = ClusterInput()
tool_names_2 = Text(tool_names)
decall = DeconstructToolCall(Request=tool_call_request)  # -> Request, Tool, Arguments
mindex = MemberIndex(Set=tool_names, Member=decall.Tool)  # -> Index, Count
sift = SiftPattern(List=decall.Request, SiftPattern=mindex.Index)  # -> Output0, Output1, Output2, Output3

# ---- group: Cluster Output
tool_names_3 = ClusterOutput(tool_names_2)

# ---- group: Get the request sent from VSC Agent
decall_2 = DeconstructToolCall(Request=sift.Output3)  # -> Request, Tool, Arguments

# ----
# COMPUTE_VOLUME_OF_CUBE
decall_3 = DeconstructToolCall(Request=sift.Output0)  # -> Request, Tool, Arguments
gjok = GetJSONObjectKey(JObject=decall_3.Arguments, Key="length")
rjv = ReadJSONValue(JValue=gjok)  # -> AsString, AsNumber, AsBool
rectangle = Rectangle(Plane=PlaneXY(0, 0, 0), XSize=rjv.AsNumber, YSize=rjv.AsNumber, Radius=0)  # -> Rectangle, Length
boxrec = BoxRectangle(Rectangle=rectangle.Rectangle, Height=rjv.AsNumber)
volume = Volume(Geometry=boxrec)  # -> Volume, Centroid
panel = Panel(volume.Volume)
cjv = CreateJSONValue(Value=panel)
cjo = CreateJSONObject(Keys="volume", Values=cjv)
respond = MCPToolResponse(Request=decall_3.Request, Content=cjo, IsError=False)

# ----
# COUNT_ELEMENTS_BY_TYPE
panel_2 = Panel("door_type")
gjok_2 = GetJSONObjectKey(JObject=decall_2.Arguments, Key="door_count")
gjok_3 = GetJSONObjectKey(JObject=decall_2.Arguments, Key=panel_2)
gjok_4 = GetJSONObjectKey(JObject=decall_2.Arguments, Key="window_count")
gjok_5 = GetJSONObjectKey(JObject=decall_2.Arguments, Key="window_type")
rjv_2 = ReadJSONValue(JValue=gjok_4)  # -> AsString, AsNumber, AsBool
rjv_3 = ReadJSONValue(JValue=gjok_5)  # -> AsString, AsNumber, AsBool
rjv_4 = ReadJSONValue(JValue=gjok_2)  # -> AsString, AsNumber, AsBool
rjv_5 = ReadJSONValue(JValue=gjok_3)  # -> AsString, AsNumber, AsBool
list_length = ListLength(List=rjv_4.AsNumber)
list_length_2 = ListLength(List=rjv_2.AsNumber)
panel_3 = Panel(list_length)
panel_4 = Panel(rjv_5.AsString)
panel_5 = Panel(list_length_2)
panel_6 = Panel(rjv_3.AsString)
cjv_2 = CreateJSONValue(Value=panel_3)
cjv_3 = CreateJSONValue(Value=panel_4)
cjv_4 = CreateJSONValue(Value=panel_5)
cjv_5 = CreateJSONValue(Value=panel_6)
cjo_2 = CreateJSONObject(Keys="door_count", Values=cjv_2)
cjo_3 = CreateJSONObject(Keys="door_type", Values=cjv_3)
cjo_4 = CreateJSONObject(Keys="window_count", Values=cjv_4)
cjo_5 = CreateJSONObject(Keys="window_type", Values=cjv_5)
merge = Merge(Data1=cjo_2, Data2=cjo_3, Data3=cjo_4, Data4=cjo_5)
respond_2 = MCPToolResponse(Request=decall_2.Request, Content=merge, IsError=False)

# ----
# GET_WALL_GEOMETRY
decall_4 = DeconstructToolCall(Request=sift.Output2)  # -> Request, Tool, Arguments
gjok_6 = GetJSONObjectKey(JObject=decall_4.Arguments, Key="type")
gjok_7 = GetJSONObjectKey(JObject=decall_4.Arguments, Key="heigth")
gjok_8 = GetJSONObjectKey(JObject=decall_4.Arguments, Key="thickness")
gjok_9 = GetJSONObjectKey(JObject=decall_4.Arguments, Key="length")
gjok_10 = GetJSONObjectKey(JObject=decall_4.Arguments, Key="width")
rjv_6 = ReadJSONValue(JValue=gjok_6)  # -> AsString, AsNumber, AsBool
read_json_value = ReadJSONValue(JValue=gjok_10)  # -> AsString, AsNumber, AsBool
rjv_7 = ReadJSONValue(JValue=gjok_7)  # -> AsString, AsNumber, AsBool
rjv_8 = ReadJSONValue(JValue=gjok_8)  # -> AsString, AsNumber, AsBool
rjv_9 = ReadJSONValue(JValue=gjok_9)  # -> AsString, AsNumber, AsBool
multiplication = Multiplication(A=read_json_value.AsNumber, B=rjv_9.AsNumber, C=rjv_7.AsNumber, D=rjv_8.AsNumber)

panel_7 = Panel(rjv_6.AsString)
read_file = ReadFile(File="C:\Users\DD\Desktop\IAAC\AIA26_Studio\team_05\gh\doors_cost.csv", PerLineParse=True)
text_split = TextSplit(Text=read_file, Separators=",")
list_item = ListItem(List=text_split, Index="0", Wrap=True)
list_item_2 = ListItem(List=text_split, Index="1", Wrap=True)
member_index = MemberIndex(Set=list_item, Member=panel_7)  # -> Index, Count
list_item_3 = ListItem(List=list_item_2, Index=member_index.Index, Wrap=True)
cost_of_one_door = Panel(list_item_3)

multiplication_2 = Multiplication(A=multiplication, B=list_item_3)
respond_3 = MCPToolResponse(Request=decall_4.Request, Content=multiplication_2, IsError=False)

# ----
# GET_FLOORING_COST
decall_5 = DeconstructToolCall(Request=sift.Output2)  # -> Request, Tool, Arguments
gjok_11 = GetJSONObjectKey(JObject=decall_5.Arguments, Key="material")
get_json_object_key = GetJSONObjectKey(JObject=decall_5.Request, Key="room_id")
gjok_12 = GetJSONObjectKey(JObject=decall_5.Arguments, Key="area")
read_json_value_2 = ReadJSONValue(JValue=get_json_object_key)  # -> AsString, AsNumber, AsBool
rjv_10 = ReadJSONValue(JValue=gjok_11)  # -> AsString, AsNumber, AsBool
read_json_value_3 = ReadJSONValue(JValue=gjok_12)  # -> AsString, AsNumber, AsBool
panel_8 = Panel(read_json_value_2.AsString)

panel_9 = Panel(rjv_10.AsString)
read_file_2 = ReadFile(File="C:\Users\DD\Desktop\IAAC\AIA26_Studio\team_05\gh\doors_cost.csv", PerLineParse=True)
text_split_2 = TextSplit(Text=read_file_2, Separators=",")
list_item_4 = ListItem(List=text_split_2, Index="0", Wrap=True)
list_item_5 = ListItem(List=text_split_2, Index="1", Wrap=True)
member_index_2 = MemberIndex(Set=list_item_4, Member=panel_9)  # -> Index, Count
list_item_6 = ListItem(List=list_item_5, Index=member_index_2.Index, Wrap=True)
cost_of_one_door_2 = Panel(list_item_6)

multiplication_3 = Multiplication(A=read_json_value_3.AsNumber, B=list_item_6)
respond_4 = MCPToolResponse(Request=[decall_5.Request, panel_8], Content=multiplication_3, IsError=False)

# ----
# GET_MATERIAL_UNIT_COST
decall_6 = DeconstructToolCall(Request=sift.Output2)  # -> Request, Tool, Arguments
gjok_13 = GetJSONObjectKey(JObject=decall_6.Arguments, Key="material_type")
gjok_14 = GetJSONObjectKey(JObject=decall_6.Arguments, Key="grade")
rjv_11 = ReadJSONValue(JValue=gjok_13)  # -> AsString, AsNumber, AsBool
read_json_value_4 = ReadJSONValue(JValue=gjok_14)  # -> AsString, AsNumber, AsBool

panel_10 = Panel(rjv_11.AsString)
read_file_3 = ReadFile(File="C:\Users\DD\Desktop\IAAC\AIA26_Studio\team_05\gh\doors_cost.csv", PerLineParse=True)
text_split_3 = TextSplit(Text=read_file_3, Separators=",")
list_item_7 = ListItem(List=text_split_3, Index="0", Wrap=True)
list_item_8 = ListItem(List=text_split_3, Index="1", Wrap=True)
member_index_3 = MemberIndex(Set=list_item_7, Member=read_json_value_4.AsString)  # -> Index, Count
list_item_9 = ListItem(List=list_item_8, Index=member_index_3.Index, Wrap=True)

respond_5 = MCPToolResponse(Request=decall_6.Request, Content=list_item_9, IsError=False)

# ----
# GET_CEILING_COST
decall_7 = DeconstructToolCall(Request=sift.Output2)  # -> Request, Tool, Arguments
gjok_15 = GetJSONObjectKey(JObject=decall_7.Arguments, Key="material")
gjok_16 = GetJSONObjectKey(JObject=decall_7.Arguments, Key="area")
rjv_12 = ReadJSONValue(JValue=gjok_15)  # -> AsString, AsNumber, AsBool
read_json_value_5 = ReadJSONValue(JValue=gjok_16)  # -> AsString, AsNumber, AsBool

panel_11 = Panel(rjv_12.AsString)
read_file_4 = ReadFile(File="C:\Users\DD\Desktop\IAAC\AIA26_Studio\team_05\gh\doors_cost.csv", PerLineParse=True)
text_split_4 = TextSplit(Text=read_file_4, Separators=",")
list_item_10 = ListItem(List=text_split_4, Index="0", Wrap=True)
list_item_11 = ListItem(List=text_split_4, Index="1", Wrap=True)
member_index_4 = MemberIndex(Set=list_item_10, Member=panel_11)  # -> Index, Count
list_item_12 = ListItem(List=list_item_11, Index=member_index_4.Index, Wrap=True)
cost_of_one_door_3 = Panel(list_item_12)

multiplication_4 = Multiplication(A=read_json_value_5.AsNumber, B=list_item_12)
respond_6 = MCPToolResponse(Request=decall_7.Request, Content=multiplication_4, IsError=False)

or = GateOr(A=respond, B=respond_3, C=respond_2, D=respond_4, E=respond_6)
tool_call_success = ClusterOutput(or)
